% Simulink data dictionary DataDictionary.sldd

Variants = Simulink.VariantConfigurationData(
  struct(
    Configurations=[struct(
      Name="YOLO_V2_TINY",
      Description="",
      ControlVariables=struct(
        Name="AEB",
        Value=Simulink.VariantControl(Value=1, ActivationTime="update diagram", ValueType="Numeric"),
        Source="DataDictionary.sldd")), struct(
      Name="YOLO_V2",
      Description="",
      ControlVariables=struct(
        Name="AEB",
        Value=Simulink.VariantControl(Value=2, ActivationTime="update diagram", ValueType="Numeric"),
        Source="DataDictionary.sldd")), struct(
      Name="YOLO_V3_TINY",
      Description="",
      ControlVariables=struct(
        Name="AEB",
        Value=Simulink.VariantControl(Value=3, ActivationTime="update diagram", ValueType="Numeric"),
        Source="DataDictionary.sldd")), struct(
      Name="YOLO_V3",
      Description="",
      ControlVariables=struct(
        Name="AEB",
        Value=Simulink.VariantControl(Value=4, ActivationTime="update diagram", ValueType="Numeric"),
        Source="DataDictionary.sldd")), struct(
      Name="YOLO_V4_TINY",
      Description="",
      ControlVariables=struct(
        Name="AEB",
        Value=Simulink.VariantControl(Value=5, ActivationTime="update diagram", ValueType="Numeric"),
        Source="DataDictionary.sldd")), struct(
      Name="YOLO_V4",
      Description="",
      ControlVariables=struct(
        Name="AEB",
        Value=Simulink.VariantControl(Value=6, ActivationTime="update diagram", ValueType="Numeric"),
        Source="DataDictionary.sldd"))],
    VariantConfigurations=[struct(
      Name="YOLO_V2_TINY",
      Description="",
      ControlVariables=struct(
        Name="AEB",
        Value=Simulink.VariantControl(Value=1, ActivationTime="update diagram", ValueType="Numeric"),
        Source="DataDictionary.sldd"),
      SubModelConfigurations=[]), struct(
      Name="YOLO_V2",
      Description="",
      ControlVariables=struct(
        Name="AEB",
        Value=Simulink.VariantControl(Value=2, ActivationTime="update diagram", ValueType="Numeric"),
        Source="DataDictionary.sldd"),
      SubModelConfigurations=[]), struct(
      Name="YOLO_V3_TINY",
      Description="",
      ControlVariables=struct(
        Name="AEB",
        Value=Simulink.VariantControl(Value=3, ActivationTime="update diagram", ValueType="Numeric"),
        Source="DataDictionary.sldd"),
      SubModelConfigurations=[]), struct(
      Name="YOLO_V3",
      Description="",
      ControlVariables=struct(
        Name="AEB",
        Value=Simulink.VariantControl(Value=4, ActivationTime="update diagram", ValueType="Numeric"),
        Source="DataDictionary.sldd"),
      SubModelConfigurations=[]), struct(
      Name="YOLO_V4_TINY",
      Description="",
      ControlVariables=struct(
        Name="AEB",
        Value=Simulink.VariantControl(Value=5, ActivationTime="update diagram", ValueType="Numeric"),
        Source="DataDictionary.sldd"),
      SubModelConfigurations=[]), struct(
      Name="YOLO_V4",
      Description="",
      ControlVariables=struct(
        Name="AEB",
        Value=Simulink.VariantControl(Value=6, ActivationTime="update diagram", ValueType="Numeric"),
        Source="DataDictionary.sldd"),
      SubModelConfigurations=[])],
    Constraints=[],
    PreferredConfiguration="",
    DefaultConfigurationName="",
    DataDictionaryName="",
    DataDictionarySection="",
    AreSubModelConfigurationsMigrated=true,
    ComponentConfigurationData=[],
    Version="24.2"))

AEB = Simulink.VariantControl(Value=2, ActivationTime="update diagram", ValueType="Numeric")