test file "Tests"

suite "AEB"

  case "AEB" [baseline]
    model AutoDRIVE_RZR_AEB
    parameter set "Parameter Set 1": TimeOfDay = 600, WeatherID = 1  % model workspace
    parameter set "Parameter Set 2" (off): TimeOfDay = 600, WeatherID = 4  % model workspace
    parameter set "Parameter Set 3" (off): TimeOfDay = 600, WeatherID = 6  % model workspace
    parameter set "Parameter Set 4" (off): TimeOfDay = 600, WeatherID = 8  % model workspace
    parameter set "Parameter Set 5" (off): TimeOfDay = 780, WeatherID = 1  % model workspace
    parameter set "Parameter Set 6" (off): TimeOfDay = 780, WeatherID = 4  % model workspace
    parameter set "Parameter Set 7" (off): TimeOfDay = 780, WeatherID = 6  % model workspace
    parameter set "Parameter Set 8" (off): TimeOfDay = 780, WeatherID = 8  % model workspace
    parameter set "Parameter Set 9" (off): TimeOfDay = 960, WeatherID = 1  % model workspace
    parameter set "Parameter Set 10" (off): TimeOfDay = 960, WeatherID = 1  % model workspace
    parameter set "Parameter Set 11" (off): TimeOfDay = 960, WeatherID = 1  % model workspace
    parameter set "Parameter Set 12" (off): TimeOfDay = 960, WeatherID = 1  % model workspace
    parameter set "Parameter Set 13" (off): TimeOfDay = 0, WeatherID = 1  % model workspace
    parameter set "Parameter Set 14" (off): TimeOfDay = 0, WeatherID = 1  % model workspace
    parameter set "Parameter Set 15" (off): TimeOfDay = 0, WeatherID = 1  % model workspace
    parameter set "Parameter Set 16" (off): TimeOfDay = 0, WeatherID = 1  % model workspace
    cleanup callback:
      plot(squeeze(sltest_simout.get('logsout').get("X").Values.Data), ...
           squeeze(sltest_simout.get('logsout').get("Y").Values.Data), '.');
      xlim([460,540]);
      ylim([-30,50]);
      xlabel("X (m)");
      ylabel("Y (m)");
      pbaspect([1 1 1]);
    custom criteria:
      out = test.sltest_simout;

      % Verify Requirements
      test.verifyGreaterThan(out.get('logsout').get("Detection Count").Values.Data(end), 1); % Perception
      test.verifyLessThan(max(abs(out.get('logsout').get("Jerk").Values.Data)), 6); % Planning
      test.verifyLessThan(abs(mean(out.get('logsout').get("Tracking Error").Values.Data)), 1); % Control
      test.verifyEqual(out.get('logsout').get("Collision Count").Values.Data(end), uint16(0)); % Collision

      % Generate custom plots
      % plot(squeeze(out.get('logsout').get("X").Values.Data), squeeze(out.get('logsout').get("Y").Values.Data), '.');
      % xlim([460,540]);
      % ylim([-30,50]);
      % xlabel("X (m)");
      % ylabel("Y (m)");
      % pbaspect([1 1 1]);
    assessment "Collision Check" (off): At any point of time, collisionCount < uint16(1) must be true
      collisionCount: signal AutoDRIVE_RZR_AEB/Simulation|Simulation/AutoDRIVE RZR, port 2
    iteration script:
      variantOpts = {'VConfig1', 'VConfig2', 'VConfig5', 'VConfig6', 'VConfig13', 'VConfig14', 'VConfig17', 'VConfig18'};

      for i = 1:length(sltest_parameterSets)
         for j = 1:length(variantOpts)
             testIter = sltestiteration();
             setTestParam(testIter, 'ParameterSet', sltest_parameterSets{i});
             setTestParam(testIter, 'VariantConfiguration', variantOpts{j});
             addIteration(sltest_testCase, testIter);
         end
      end