# Requirement set Requirements (R2024b)

## 1 [Path Planning] Planning time
The planning time should be less than 10 seconds.

## 2 [Localization] Localization error
The localization error must be within a position tolerance of 0.5 m and orientation tolerance of 0.087 radians (5 degrees).

## 3 [Path Tracking] Reach goal
The robot shall reach its goal pose within a position tolerance of 0.5 m and orientation tolerance of 0.087 radians (5 degrees).

## 4 [⁠Velocity Tracking] Velocity error
The velocity error of the robot must be less than equal to 0.27 m/s (1 km/h).

## 5 [Obstacle Avoidance] Stay away from obstacles
The robot’s center of mass must stay away from obstacles by a distance equal to wheelbase or track width (whichever is greater).