test file "Tests"

suite "Husky G2G"

  case "PathTracking" [baseline]
    model Husky_G2G
    parameter set "Parameter Set 1": waypoints = wp_a_star  % DataDictionary.sldd
    parameter set "Parameter Set 2" (off): waypoints = wp_a_star_hybrid  % DataDictionary.sldd
    parameter set "Parameter Set 3" (off): waypoints = wp_rrt  % DataDictionary.sldd
    parameter set "Parameter Set 4" (off): waypoints = wp_rrt_star  % DataDictionary.sldd
    parameter set "Parameter Set 5" (off): waypoints = wp_bi_rrt  % DataDictionary.sldd
    parameter set "Parameter Set 6" (off): waypoints = wp_prm  % DataDictionary.sldd
    custom criteria:
      %Use the Simulink Test infrastructure to create non-invasive tests
      X = test.sltest_simout.logsout.get('X').Values.Data;
      Y = test.sltest_simout.logsout.get('Y').Values.Data;
      goalPoseX = 240;
      goalPoseY = 105;
      test.verifyLessThan(min(abs(X-goalPoseX)),.5);
      test.verifyLessThan(min(abs(Y-goalPoseY)),.5);
    iterations:
      Iteration1: ParameterSet "Parameter Set 1"  % A*
      Iteration2: ParameterSet "Parameter Set 2"  % Hybrid A*
      Iteration3: ParameterSet "Parameter Set 3"  % Rapidly Exploring Random Tree (RRT)
      Iteration4: ParameterSet "Parameter Set 4"  % RRT*
      Iteration5: ParameterSet "Parameter Set 5"  % Bi-Directional RRT
      Iteration6: ParameterSet "Parameter Set 6"  % Probabilistic Roadmaps (PRM)

  case "VelocityTracking" [baseline]
    model Husky_G2G
    assessment "linearVelocityErrorCheck": At any point of time, abs(actualLinearVelocity-desiredLinearVelocity) < 0.31 must be true
      desiredLinearVelocity: signal VIPR_Arch_v2/Determine drive commands|DetermineDriveCommands/Pure Pursuit, port 1
      actualLinearVelocity: signal VIPR_Arch_v2/Move robot/MathWorks Model|MathWorksModel/Vehicle Model/Sqrt, port 1